# Grasshopper definition experiment.gh (Grasshopper 1.0.7)
# plug-ins: MeshSimulation, Human

number_slider = Slider(0.5, range=0..1)
number_slider_2 = Slider(22, range=0..100)
number_slider_3 = Slider(90, range=0..100)
pt = ConstructPoint(XCoordinate=number_slider, YCoordinate=number_slider, ZCoordinate=0)
xy = XYPlane(Origin=Point(0, 0, 0))
move = Move(Geometry=xy, Motion=pt)  # -> Geometry, Transform
sqgrid = Square(Plane=move.Geometry, Size=1, ExtentX=number_slider_2, ExtentY=number_slider_3)  # -> Cells, Points
image = ImageSampler(
    sqgrid.Points,
    FilePath="E:\大四下\课\venous\code\MeshSimulation\experiments\mesh4.png",
    Filter="Colour",
    Interpolate=False,
    Umax=22,
    Umin=0,
    Vmax=90,
    Vmin=0,
    Wrap=1)
python = GhPythonScript(x=image)  # -> out, a
# ---------- python: Python ----------
__author__ = "YTY"
__version__ = "2020.05.12"

import rhinoscriptsyntax as rs
if(x[0]>250 and x[1]>250 and x[2]>250):
    a = 1
elif(x[2]>250):
    a = 2
else:
    a = 0
# ---------- end python ----------

number_slider_4 = Slider(20, range=0..20)
sqgrid_2 = Square(Plane=PlaneXY(0, 0, 0), Size=1, ExtentX=number_slider_3, ExtentY=number_slider_3)  # -> flatten(Cells), Points
sqgrid_3 = Square(Plane=PlaneXY(0, 0, 0), Size=Slider(5, range=0..10), ExtentX=number_slider_4, ExtentY=number_slider_4)  # -> flatten(Cells), Points
previewlw = CustomPreviewLineweights(Geometry=sqgrid_3.Cells, Shader=ColourSwatch(SwatchColor=RGB(224, 224, 224)), Absolute=False)
previewlw_2 = CustomPreviewLineweights(Geometry=sqgrid_2.Cells, Shader=ColourSwatch(SwatchColor=RGB(161, 161, 161)), Absolute=False)

pt_2 = Point(Point(10.61733495, 2.605279623, 0))
timer = Timer(TimerInterval=100, Target=meshsimulation)  # disabled

meshsimulation = MeshSimulation(
    Reset=Toggle(False),
    Height=number_slider_3,
    Width=number_slider_2,
    Step=Slider(1, range=0..1),
    VolumeMesh=python.a,
    LiquidSourcePointList=pt_2,
    LiquidSourcePressureList=Slider(0.321, range=0..10))  # -> Output, DisplayMesh

panel = Panel(meshsimulation.Output)
