# Grasshopper definition experiment3D.gh (Grasshopper 1.0.7)
# plug-ins: MeshSimulation

number_slider = Slider(44, range=0..100)
pt = Point(Point(15.65804574, 0.825659601, 0))
meshsimulation3d = MeshSimulation3D(
    Reset=Toggle(True),
    X_extent=number_slider,
    Y_extent=number_slider,
    Z_extent=number_slider,
    Step=Slider(1, range=0..1),
    X_num=Slider(3, range=0..10),
    Y_num=Slider(1, range=0..10),
    Z_num=Slider(1, range=0..10),
    EdgeLength=Slider(10, range=0..10),
    LiquidSourcePointList=pt,
    LiquidSourcePressureList=Slider(0.549, range=0..10))  # -> Output, DisplayMesh
panel = Panel(meshsimulation3d.Output)
