# Grasshopper definition linear.gh (Grasshopper 1.0.7)
# plug-ins: MeshSimulation, Human

number_slider = Slider(0.5, range=0..1)
number_slider_2 = Slider(50, range=0..100)
pt = ConstructPoint(XCoordinate=number_slider, YCoordinate=number_slider, ZCoordinate=0)
xy = XYPlane(Origin=Point(0, 0, 0))
number_slider_3 = Slider(10, range=0..10)
move = Move(Geometry=xy, Motion=pt)  # -> Geometry, Transform
sqgrid = Square(Plane=move.Geometry, Size=1, ExtentX=number_slider_2, ExtentY=number_slider_2)  # -> Cells, Points
sqgrid_2 = Square(Plane=PlaneXY(0, 0, 0), Size=1, ExtentX=number_slider_2, ExtentY=number_slider_2)  # -> flatten(Cells), Points
sqgrid_3 = Square(Plane=PlaneXY(0, 0, 0), Size=Slider(5, range=0..10), ExtentX=number_slider_3, ExtentY=number_slider_3)  # -> flatten(Cells), Points
image = ImageSampler(
    sqgrid.Points,
    FilePath="E:\大四下\课\venous\code\MeshSimulation\experiments\linear2.png",
    Filter="Colour",
    Interpolate=False,
    Umax=50,
    Umin=0,
    Vmax=50,
    Vmin=0,
    Wrap=1)
previewlw = CustomPreviewLineweights(Geometry=sqgrid_3.Cells, Shader=ColourSwatch(SwatchColor=RGB(224, 224, 224)), Absolute=False)
previewlw_2 = CustomPreviewLineweights(Geometry=sqgrid_2.Cells, Shader=ColourSwatch(SwatchColor=RGB(161, 161, 161)), Absolute=False)
python = GhPythonScript(x=image)  # -> out, a
# ---------- python: Python ----------
__author__ = "YTY"
__version__ = "2020.05.12"

import rhinoscriptsyntax as rs
if(x[0]>250 and x[1]>250 and x[2]>250):
    a = 1
elif(x[2]>250):
    a = 2
else:
    a = 0
# ---------- end python ----------
pt_2 = Point(Point(29.34695501, 22.43346986, 0))
timer = Timer(TimerInterval=100, Target=meshsimulation)  # disabled
dup = DuplicateData(Data=Slider(8.554, range=0..10), Number=Slider(1, range=0..10), Order=True)
merge = Merge(Data1=pt_2)
meshsimulation = MeshSimulation(
    Reset=Toggle(True),
    Height=number_slider_2,
    Width=number_slider_2,
    Step=Slider(1, range=0..1),
    VolumeMesh=python.a,
    LiquidSourcePointList=merge,
    LiquidSourcePressureList=dup)  # -> Output, DisplayMesh
panel = Panel(meshsimulation.Output)
